# Grasshopper definition cube.gh (Grasshopper 1.0.7)

pt = Point([Point(-146.2473778, -3.761878431, 0), Point(114.8773919, -30.39094397, 0), Point(-26.8795579, 216.8658581, 0), Point(128.5398999, 32.72041797, 230.1137369)])

item = ListItem(List=pt, Index=0, Wrap=True)  # -> Item, Item1, Item2
points = PointList(Points=pt, Size=Slider(50, range=0..100))
rec_3pt = Rectangle3Pt(PointA=item.Item, PointB=item.Item1, PointC=item.Item2)  # -> Rectangle, Length

item_2 = ListItem(List=pt, Index=0, Wrap=True)  # -> Item, Item1, Item2, Item3
vec2pt = Vector2Pt(PointA=item_2.Item, PointB=item_2.Item1, Unitize=False)  # -> Vector, Length
Z = UnitZ(Factor=1)
X = UnitX(Factor=1)
xy = XYPlane(Origin=Point(0, 0, 0))
pl = ConstructPlane(Origin=item_2.Item, XAxis=vec2pt.Vector, YAxis=Z)
dist = Distance(PointA=item_2.Item, PointB=item_2.Item1)
pdecon = Deconstruct(Point=item_2.Item3)  # -> XComponent, YComponent, ZComponent
angle = Angle(VectorA=X, VectorB=vec2pt.Vector, Plane=xy)  # -> Angle, Reflex
cp = PlaneClosestPoint(Point=item_2.Item2, Plane=pl)  # -> Point, UVPoint, Distance
division = Division(A=dist, B="2")
division_2 = Division(A=pdecon.ZComponent, B="2")
ln = Line(StartPoint=item_2.Item2, EndPoint=cp.Point)
vec2pt_2 = Vector2Pt(PointA=cp.Point, PointB=item_2.Item2, Unitize=False)  # -> Vector, Length
division_3 = Division(A=cp.Distance, B="2")
amp = Amplitude(Vector=vec2pt_2.Vector, Amplitude=cp.Distance)
pt_2 = Point([item_2.Item, item_2.Item1])
rev = Reverse(Vector=amp)
Z_2 = UnitZ(Factor=division_2)
move = Move(Geometry=pt_2, Motion=rev)  # -> Geometry, Transform
avr = Average(Input=[move.Geometry, pt_2])
move_2 = Move(Geometry=pt_2, Motion=amp)  # -> Geometry, Transform
avr_2 = Average(Input=[move_2.Geometry, pt_2])
dist_2 = Distance(PointA=item_2.Item2, PointB=avr)
dist_3 = Distance(PointA=item_2.Item2, PointB=avr_2)
larger = LargerThan(FirstNumber=dist_3, SecondNumber=dist_2)  # -> LargerThan, OrEqualTo
filter = StreamFilter(Gate=larger.LargerThan, Stream0=avr_2, Stream1=avr)
move_3 = Move(Geometry=filter, Motion=Z_2)  # -> Geometry, Transform
box = CenterBox(Base=move_3.Geometry, X=division, Y=division_3, Z=division_2)
rotate = Rotate(Geometry=box, Angle=angle.Angle, Plane=move_3.Geometry)  # -> Geometry, Transform
