# Grasshopper definition cube_gh_rebuild.gh (Grasshopper 1.0.7)

c_script = CSharpScript()  # -> out, cube_objects; inputs x: String
# ---------- c_script: C# usings ----------
using System.Text.RegularExpressions;
# ---------- c_script: C# ----------
    List<Box> box_list = new List<Box>();
    List<Point3d> pt_list = new List<Point3d>();

    string[] Str_b = x.Split(new string[] {"!"}, StringSplitOptions.RemoveEmptyEntries);
    foreach(string s in Str_b)
    {
      string[] ss = s.Split(new string[] {"?"}, StringSplitOptions.RemoveEmptyEntries);

      float x_p;
      float y_p;
      float z_p;

      double Rotate_1;
      double Rotate_2;

      float x_s;
      float y_s;
      float z_s;

      string[] sss = ss[0].Split(new string[] {",","(",")"}, StringSplitOptions.RemoveEmptyEntries);
      x_p = float.Parse(Regex.Replace(sss[0], @"\s", ""));
      y_p = float.Parse(Regex.Replace(sss[1], @"\s", ""));
      z_p = float.Parse(Regex.Replace(sss[2], @"\s", ""));

      Rotate_1 = Math.PI / 180.0 * float.Parse(ss[1]);
      Rotate_2 = Math.PI / 180.0 * (float.Parse(ss[2]) * -1);

      string[] ssss = ss[3].Split(new string[] {",","(",")"}, StringSplitOptions.RemoveEmptyEntries);
      x_s = float.Parse(Regex.Replace(ssss[0], @"\s", ""));
      y_s = float.Parse(Regex.Replace(ssss[1], @"\s", ""));
      z_s = float.Parse(Regex.Replace(ssss[2], @"\s", ""));

      Point3d pt_ = new Point3d(x_p, y_p, z_p);
      Interval xInterval = new Interval(x_p - (x_s / 2), x_p + (x_s / 2));
      Interval yInterval = new Interval(y_p - (y_s / 2), y_p + (y_s / 2));
      Interval zInterval = new Interval(z_p - (z_s / 2), z_p + (z_s / 2));
      Transform rotate1 = Transform.Rotation(Rotate_1, new Vector3d(0, 1, 0), pt_);
      Transform rotate2 = Transform.Rotation(Rotate_2, new Vector3d(0, 0, 1), pt_);

      Box box_ = new Box(Plane.WorldXY, xInterval, yInterval, zInterval);
      box_.Transform(rotate1);
      box_.Transform(rotate2);

      //pt_list.Add(pt_);
      box_list.Add(box_);

    }

    cube_objects = box_list;
# ---------- end c_script ----------
