# Grasshopper definition error_checking.gh (Grasshopper 1.0.7)

txt = Text()
txt_2 = Text()
c_script = CSharpScript(check=[txt_2, txt])  # -> out, A; inputs check: list of String, mergeAxis: list
# ---------- c_script: C# ----------
    foreach(string j in check)
    {
      if(j.Contains("1") == true)
      {
        A = "$RunError";
        return;
      }
    }
    string allaxis = "$";
    for(int i = 0;i < mergeAxis.Count;i++)
    {
      allaxis = allaxis + mergeAxis[i] + "!";
    }
    A = allaxis;
# ---------- end c_script ----------

# ---- group: 看有沒有錯誤
panel = Panel(c_script.A)
