# Grasshopper definition gh_rebuild_In_Out.gh (Grasshopper 1.0.7)

c_script = CSharpScript()  # -> out, A; inputs dis: Double, Cout_S: list of Point3d, Cout_E: list of Point3d, Cin_S: list of Point3d, Cin_E: list of Point3d
# ---------- c_script: C# ----------
    A =  (dis_ * 0.001).ToString("#0.000") + "$" + To(Cout_S, Cout_E) + "$" + To(Cin_S, Cin_E);
# ---------- c_script: C# additional code ----------
  public string To(List<Point3d> x, List<Point3d> y)
  {
    double unitU = 0.001;
    List<string> ca_pt = new List<string>();

    for(int i = 0;i < x.Count;i++)
    {
      string curve_A;
      curve_A = (x[i].X * unitU).ToString("#0.000") + "," +
        (x[i].Y * unitU).ToString("#0.000") + "," + (x[i].Z * unitU).ToString("#0.000");
      string curve_B;
      curve_B = (y[i].X * unitU).ToString("#0.000") + "," +
        (y[i].Y * unitU).ToString("#0.000") + "," + (y[i].Z * unitU).ToString("#0.000");

      ca_pt.Add(curve_A + "?" + curve_B);
    }

    string merge_A = "";
    if(ca_pt.Count > 1) //如果有多條線段
    {
      for(int j = 0;j < ca_pt.Count;j++)
      {
        merge_A = merge_A + ca_pt[j] + "!";
      }
    }
    else
    {
      merge_A = ca_pt[0];
    }
    return merge_A;
  }
# ---------- end c_script ----------
