# Grasshopper definition pick_material.gh (Grasshopper 1.0.7)

line = Line()

# ---- group: 高點到低點的向量
disc = Discontinuity(Curve=line, Level=1)  # -> Points, Parameters
pdecon = Deconstruct(Point=disc.Points)  # -> XComponent, YComponent, ZComponent
sort = SortList(Keys=pdecon.ZComponent, ValuesA=disc.Points)  # -> Keys, ValuesA
item = ListItem(List=sort.ValuesA, Index=0, Wrap=True)  # -> Item, Item1
vec2pt = Vector2Pt(PointA=item.Item1, PointB=item.Item, Unitize=False)  # -> Vector, Length

# ----
curvepoint = PointOnCurve(line, parameter=0.5)
pl = ConstructPlane(Origin=curvepoint, XAxis=Vector(1, 0, 0), YAxis=vec2pt.Vector)
deplane = DeconstructPlane(Plane=pl)  # -> Origin, XAxis, YAxis, ZAxis
devec = DeconstructVector(Vector=vec2pt.Vector)  # -> XComponent, YComponent, ZComponent
vrot = Rotate(Vector=vec2pt.Vector, Axis=deplane.ZAxis, Angle=degrees("-90"))
devec_2 = DeconstructVector(Vector=deplane.ZAxis)  # -> XComponent, YComponent, ZComponent
pl_2 = ConstructPlane(Origin=curvepoint, XAxis=vrot, YAxis=vec2pt.Vector)
larger = LargerThan(FirstNumber=devec.XComponent, SecondNumber="0")  # -> LargerThan, OrEqualTo
larger_2 = LargerThan(FirstNumber=devec_2.ZComponent, SecondNumber="0")  # -> LargerThan, OrEqualTo
pln = Plane(pl_2)
rotateabc = RotateABC(plane=pln, xa=Slider(0, range=-180..180), ya=Slider(-135, range=-180..180), za=Slider(0, range=-180..180))
rotateabc_2 = RotateABC(plane=pln, xa=Slider(0, range=-180..180), ya=Slider(135, range=-180..180), za=Slider(0, range=-180..180))

# ---- group: 前頃的左還右
filter = StreamFilter(Gate=larger.LargerThan, Stream0=rotateabc, Stream1=rotateabc_2)

# ----
pflip = FlipPlane(Plane=filter, ReverseX=False, ReverseY=False, SwapAxes=True)
prot = RotatePlane(Plane=pflip, Angle=degrees(Slider(-90, range=-90..90)))

# ---- group: 1.如何判斷前頃還是後仰
材料組裝位置 = StreamFilter(Gate=larger_2.LargerThan, Stream0=pln, Stream1=prot)

# ----
deplane_2 = DeconstructPlane(Plane=材料組裝位置)  # -> Origin, XAxis, YAxis, ZAxis
devec_3 = DeconstructVector(Vector=deplane_2.YAxis)  # -> XComponent, YComponent, ZComponent
graph = GraphMapper(devec_3.ZComponent, x0=-1, x1=0, y0=-35, y1=0, container_name="Bezier", cpx=[0, 0, 1, 1], cpy=[0, 1, 1, 1])
panel = Panel(devec_3.ZComponent)

# ---- group: 前頃的左還右
filter_2 = StreamFilter(Gate=larger.LargerThan, Stream0=Slider(45, range=0..100), Stream1=Slider(-45, range=-100..-45))

# ----
number_slider = Slider(100, range=0..500)
vrot_2 = Rotate(Vector=deplane_2.YAxis, Axis=deplane_2.XAxis, Angle=degrees(Slider(-135, range=-1000..-135)))
panel_2 = Panel(graph)
vrot_3 = Rotate(Vector=vrot_2, Axis=deplane_2.YAxis, Angle=degrees(filter_2))
vrot_4 = Rotate(Vector=deplane_2.ZAxis, Axis=deplane_2.XAxis, Angle=degrees(panel_2))
amp = Amplitude(Vector=vrot_4, Amplitude=expr("x*-1", number_slider))
amp_2 = Amplitude(Vector=vrot_3, Amplitude=number_slider)

# ---- group: 前頃還是後仰
filter_3 = StreamFilter(Gate=larger_2.LargerThan, Stream0=amp, Stream1=amp_2)

# ----
move = Move(Geometry=材料組裝位置, Motion=filter_3)  # -> Geometry, Transform
number_slider_2 = Slider(180, range=0..1000)

# ---- group: 材料組裝位置
prot_2 = RotatePlane(Plane=材料組裝位置, Angle=degrees(number_slider_2))

# ---- group: 材料組裝偏移位置
prot_3 = RotatePlane(Plane=move.Geometry, Angle=degrees(number_slider_2))

# ---- group: 夾棒棒的治具
pt = ConstructPoint(
    XCoordinate=Slider(902.785, range=0..1000),
    YCoordinate=Slider(657.89, range=0..1000),
    ZCoordinate=Slider(-249.359, range=-249.359..200))
Z = UnitZ(Factor=Slider(-60, range=-100..-60))
brep = Brep(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)

# ---- group: 夾棒棒的治具 / pin的點
number_slider_3 = Slider(8, range=0..100)
pt_2 = Point(pt)

# ---- group: 夾棒棒的治具 (continued)
X = UnitX(Factor=number_slider_3)
move_2 = Move(Geometry=pt_2, Motion=X)  # -> Geometry, Transform
move_3 = Move(Geometry=move_2.Geometry, Motion=Z)  # -> Geometry, Transform
orient = Orient(Geometry=brep, Source=PlaneXY(0, 0, 0), Target=pt_2)  # -> Geometry, Transform
preview = CustomPreview(Geometry=orient.Geometry, Material=ColourSwatch(SwatchColor=RGBA(194, 136, 136, 195)))

# ---- group: 夾棒棒的治具 / 材料放置端點
pt_3 = Point(move_3.Geometry)

# ---- group: 算治具上棒棒的夾持位置
Z_2 = UnitZ(Factor=1)
len = Length(Curve=line)
line_2 = LineSDL(Start=pt_3, Direction=Z_2, Length=len)
end = EndPoints(Curve=line_2)  # -> Start, End
midpt = CurveMiddle(Curve=line_2)
yz = YZPlane(Origin=midpt)
aligndim = AlignedDimension(Plane=yz, PointA=end.Start, PointB=end.End, Offset=100, Text="{0:0.00}", Size=50)

# ---- group: Pick_Unit_Middle
pt_4 = Point(midpt)

# ==== cluster RotateABC
number_slider = Slider(-13, range=-180..180)
plane = ClusterInput()
number_slider_2 = Slider(10, range=-180..180)
number_slider_3 = Slider(-22, range=-180..180)
ya = ClusterInput()
xa = ClusterInput()
za = ClusterInput()
pln = Plane(plane)
deplane = DeconstructPlane(Plane=pln)  # -> Origin, XAxis, YAxis, ZAxis
line = LineSDL(Start=pln, Direction=deplane.ZAxis, Length=1)
rotax = RotateAxis(Geometry=pln, Angle=degrees(za), Axis=line)  # -> Geometry, Transform
deplane_2 = DeconstructPlane(Plane=rotax.Geometry)  # -> Origin, XAxis, YAxis, ZAxis
line_2 = LineSDL(Start=deplane_2.Origin, Direction=deplane_2.XAxis, Length=1)
rotax_2 = RotateAxis(Geometry=rotax.Geometry, Angle=degrees(xa), Axis=line_2)  # -> Geometry, Transform
deplane_3 = DeconstructPlane(Plane=rotax_2.Geometry)  # -> Origin, XAxis, YAxis, ZAxis
line_3 = LineSDL(Start=deplane_3.Origin, Direction=deplane_3.YAxis, Length=1)
rotax_3 = RotateAxis(Geometry=rotax_2.Geometry, Angle=degrees(ya), Axis=line_3)  # -> Geometry, Transform
pln_2 = Plane(rotax_3.Geometry)
pln_3 = ClusterOutput(pln_2)
