# Grasshopper definition rebuild_line.gh (Grasshopper 1.0.7)

c_script = CSharpScript()  # -> out, DLine; inputs x: String
# ---------- c_script: C# ----------
    List<Point3d> line_pt_list = new List<Point3d>();

    string[] Str = x.Split(new string[] {"?","(",")"}, StringSplitOptions.RemoveEmptyEntries);
    foreach(string s in Str)
    {
      string[] sss = s.Split(new string[] {","}, StringSplitOptions.RemoveEmptyEntries);
      Point3d pt_ = new Point3d(float.Parse(sss[0])*1000, float.Parse(sss[2])*1000, float.Parse(sss[1])*1000);
      line_pt_list.Add(pt_);
    }
    Line line_ = new Line(line_pt_list[0], line_pt_list[1]);

    DLine = line_;
# ---------- end c_script ----------
