# Grasshopper definition wall.gh (Grasshopper 1.0.7)

# ---- group: 地板
pt = Point(Point(85.74129758, 124.9992865, -472.819082))

# ---- group: 角落
pt_2 = Point([Point(-389.836314, 2255.315237, 0), Point(2320.053506, 1715.372849, 0), Point(1489.49596, -1320.943713, 0), Point(-1073.708848, -628.0634228, 0), Point(-1556.001605, 921.8208043, 0)])

# ---- group: 天花板
pt_3 = Point(Point(247.7255795, 49.7931944, 841.3475496))

# ----
pdecon = Deconstruct(Point=pt)  # -> XComponent, YComponent, ZComponent
pdecon_2 = Deconstruct(Point=pt_2)  # -> XComponent, YComponent, ZComponent
pdecon_3 = Deconstruct(Point=pt_3)  # -> XComponent, YComponent, ZComponent
pt_4 = ConstructPoint(XCoordinate=pdecon_2.XComponent, YCoordinate=pdecon_2.YComponent, ZCoordinate=pdecon.ZComponent)
pt_5 = ConstructPoint(XCoordinate=pdecon_2.XComponent, YCoordinate=pdecon_2.YComponent, ZCoordinate=pdecon_3.ZComponent)
lng = ListLength(List=pt_2)
weave = Weave(Pattern=[0, 1], Stream0=pt_5, Stream1=pt_4, NullGaps=False)
series = Series(Start=0, Step="2", Count=lng)
lng_2 = ListLength(List=weave)
addition = Addition(A=series, B=Slider(1, range=0..1))
addition_2 = Addition(A=series, B=Slider(3, range=0..10))
addition_3 = Addition(A=lng_2, B="2")
addition_4 = Addition(A=series, B=Slider(2, range=0..10))
repeat = RepeatData(Data=weave, Length=addition_3)
points = PointList(Points=weave, Size=Slider(517, range=0..1000))
quad = MeshQuad(CornerA=series, CornerB=addition, CornerC=addition_2, CornerD=addition_4)
conmesh = ConstructMesh(Vertices=repeat, Faces=quad)
panel = Panel(conmesh)
